# Grasshopper definition temp.gh (Grasshopper 1.0.7)

read_file = ReadFile(File="C:\Zac\19 Github\ZacZhangzhuo.github.io\tools\zAddItems.py", PerLineParse=False)
# Z
_0_to_1_00 = Slider(0, range=0..1)
_1_to_100 = Slider(0, range=0..100)
ghpython_script = GhPythonScript(Code=read_file)  # -> Out, A
c_script = CSharpScript()  # -> Out, A
panel = Panel(ghpython_script.Out)
