# Grasshopper definition visualization.ghx (Grasshopper 1.0.7)

panel = Panel("C:\Users\Zac\Desktop")
read_file = ReadFile(PerLineParse=False)
_0_to_1_00 = Slider(0, range=0..1)
_1_to_100 = Slider(0, range=0..100)
ghpython_script = GhPythonScript(location="C:\Zac\GitHub\ZacZhangzhuo.github.io\son.json")  # -> out, points, radiuses
# ---------- ghpython_script: Python ----------
from compas import json_load
import Rhino.Geometry as rg
data = json_load (location)


radiuses = [d["Radius"] for d in data]
thePoints = [d["Point"] for d in data]

points = []
for p in thePoints:
    points.append(rg.Point3d(p[0],p[1],p[2]))
# ---------- end ghpython_script ----------
c_script = CSharpScript()  # -> Out, A
ghpython_script_2 = GhPythonScript(location="C:\Zac\GitHub\ZacZhangzhuo.github.io\father.json")  # -> out, points, radiuses; same code as ghpython_script
integer = Integer()
sphere = Sphere(Base=ghpython_script.points, Radius=ghpython_script.radiuses)
sphere_2 = Sphere(Base=ghpython_script_2.points, Radius=ghpython_script_2.radiuses)
